# Dynamo graph example multiple ProgressBar.dyn (Dynamo 2.10.0.3455)

# group: sample Example
python_script_module = Python()  # "Python Script | Module ProgressBarUtils"; IronPython2
# ---------- python_script_module.python (166 lines) ----------
import sys
import clr
import System
clr.AddReference('System.Drawing')
clr.AddReference('System.Windows.Forms')
import System.Drawing
import System.Windows.Forms

from System.Drawing import *
from System.Windows.Forms import *

from System.Windows.Forms import Application, Form, ProgressBar
from System.Threading import ThreadStart, Thread

class ProgressBarUtils():
	guid = "a8c3aa76-f731-4086-ae08-8cb41464e425"
	def __init__(self):
		pass
		
	def __name__(self):
		return 'ProgressBarUtils'
		

	class ProgressBarDialog(Form):
		def __init__(self, theBroadcaster, lstNameOperation, title):
			self._lstNameOperation = lstNameOperation #numberLines is a list of number
			print(lstNameOperation)
			self._theBroadcaster = theBroadcaster
			self._title = title
			self._theBroadcaster.onChange += self.myFunction
			self.lstProgressBar = []
			self.lstlabel = []
			self._counter = 0
			self._defaultValue = 2000000 # set a large valu
			self.InitializeComponent()
			
		
		def InitializeComponent(self):
			self._buttonCancel = System.Windows.Forms.Button()
			self.SuspendLayout()
			# 
			# buttonCancel
			# 
			self._buttonCancel.Location = System.Drawing.Point(228, 96)
			self._buttonCancel.Name = "buttonCancel"
			self._buttonCancel.Size = System.Drawing.Size(116, 32)
			self._buttonCancel.TabIndex = 0
			self._buttonCancel.Text = "Quit"
			self._buttonCancel.UseVisualStyleBackColor = True
			self._buttonCancel.Click += self.ButtonCancelClick
			i = 22
			for prefixLabel in self._lstNameOperation:
				# label1
				# 
				self._label1 = System.Windows.Forms.Label()
				self._label1.Location = System.Drawing.Point(12, i)
				self._label1.Name = "label"
				self._label1.Size = System.Drawing.Size(250, 23)
				self._label1.TabIndex = 2
				self._label1.Text = "{} : 0/{}".format(prefixLabel, "???")
				self.Controls.Add(self._label1)
				self.lstlabel.append(self._label1)
				# 
				# progressBar1
				# 
				self._progressBar1 = System.Windows.Forms.ProgressBar()
				self._progressBar1.Location = System.Drawing.Point(12, i + 26)
				self._progressBar1.Name = "progressBar"
				self._progressBar1.Size = System.Drawing.Size(535, 23)
				self._progressBar1.Minimum = 1
				self._progressBar1.Maximum = self._defaultValue
				self._progressBar1.Step = 1
				self._progressBar1.Value = 1
				self._progressBar1.TabIndex = 1
				self.Controls.Add(self._progressBar1)
				self.lstProgressBar.append(self._progressBar1)
				i += 80
				
			i += 20
			# 
			# MainForm
			# 
			self.ClientSize = System.Drawing.Size(567, i)

			#self.Controls.Add(self._buttonCancel)
			self.Name = "MainForm"
			self.Text = self._title
			self.ResumeLayout(False)
			
		def myFunction(self):
			self._counter += 1
			maxOperat = sum(x.Maximum for x in self.lstProgressBar)
			if self._counter < maxOperat:
				for p, l , prefixLabel in zip(self.lstProgressBar, self.lstlabel, self._lstNameOperation):
					if p.Value < p.Maximum:
						p.Value += 1
						l.Text =  "{} : {}/{}".format(prefixLabel, str(p.Value), str(p.Maximum))
						break
					else:
						p.Value = p.Maximum
				try:
					Application.DoEvents()
				except:pass	
					
			else:
				self._theBroadcaster.onChange -= self.myFunction	
				self.Close()				
	
	
		def ButtonCancelClick(self, sender, e):
			self.Close()
			
	
			
	class EventHook(object):
		def __init__(self):
			self.__handlers = []
			
		def __iadd__(self, handler):
			self.__handlers.append(handler)
			return self
	
		def __isub__(self, handler):
			self.__handlers.remove(handler)
			return self
	
		def next_p(self, *args, **keywargs):
			for handler in self.__handlers:
				handler(*args, **keywargs)
	
		def clearObjectHandlers(self, inObject):
			for theHandler in self.__handlers:
				if theHandler.im_self == inObject:
					self -= theHandler
					
		def forceClearHandlers(self):
			for theHandler in self.__handlers:
				self -= theHandler
			
	
	class MyProgressBroadcaster():
		"""
		main Class to Start UI and build a custom Event with a  ContextManager
		"""
		def __init__(self, numberLines, title = "My_progressBar"):
			self.numberLines = numberLines
			self.purg = False
			self.title = title
			self.f = None
			
		def SetProgressAtIndex(self, idx, number):
			if self.f is not None:
				self.f.lstProgressBar[idx].Maximum = number
				
		def __enter__(self):		
			self.onChange = ProgressBarUtils.EventHook()	
			Application.EnableVisualStyles()
			self.f = ProgressBarUtils.ProgressBarDialog(self, self.numberLines, self.title)
			self.f.Show()
			return 	self
			
		def __exit__(self, type, value, traceback):
			self.onChange.forceClearHandlers()


OUT = ProgressBarUtils
# ----------------------------------------
number_of_triangle_pass1 = IntegerSlider(2370, range=10..4000 step 10)
number_of_triangle_pass2 = IntegerSlider(2980, range=10..4000 step 10)
number_of_triangle_pass3 = IntegerSlider(1750, range=10..4000 step 10)
min_max_triangulation = CodeBlock { 0; 100; 120; 220; }
python_script_main = Python(IN[0]=python_script_module, IN[1]=number_of_triangle_pass1, IN[2]=number_of_triangle_pass2, IN[3]=number_of_triangle_pass3, IN[4]=min_max_triangulation.out2, IN[5]=min_max_triangulation.out3)  # IronPython2
# ---------- python_script_main.python (66 lines) ----------
# Charger les bibliothèques DesignScript et Standard Python
import sys
import clr
import System
import time
clr.AddReference('ProtoGeometry')
from Autodesk.DesignScript.Geometry import *
import  Autodesk.DesignScript.Geometry as DS
clr.AddReference('DSCoreNodes') 
import DSCore
from DSCore import *
clr.AddReference('GeometryColor')
from Modifiers import GeometryColor

clr.AddReference('System.Drawing')
clr.AddReference('System.Windows.Forms')
import System.Drawing
import System.Windows.Forms

from System.Drawing import *
from System.Windows.Forms import *

from System.Windows.Forms import Application, Form, ProgressBar
from System.Threading import ThreadStart, Thread

def tringleGenerator(numberLines):
	global out
	for i in range(numberLines):
		#Thread.Sleep(1)
		pta = DS.Point.ByCoordinates(myRandom.Next(mintr, maxtr), myRandom.Next(mintr, maxtr), myRandom.Next(mintr, maxtr))
		ptb = DS.Point.ByCoordinates(myRandom.Next(mintr, maxtr), myRandom.Next(mintr, maxtr), myRandom.Next(mintr, maxtr))
		if pta.DistanceTo(ptb) < 0.1:
			ptb = DS.Point.ByCoordinates(myRandom.Next(mintr, maxtr), myRandom.Next(mintr, maxtr), myRandom.Next(mintr, maxtr))
		ptc = DS.Point.ByCoordinates(myRandom.Next(mintr, maxtr), myRandom.Next(mintr, maxtr), myRandom.Next(mintr, maxtr))	
		triang = DS.Surface.ByPerimeterPoints([pta,ptb, ptc])
		triang = GeometryColor.ByGeometryColor(triang, DSCore.Color.ByARGB(255,myRandom.Next(255), myRandom.Next(255), myRandom.Next(255)))	
		out.append(triang)
		# fire event
		broadcaster.onChange.next_p()

moduleBarUtils = IN[0]()
numberTriangA = IN[1]
numberTriangB = IN[2]
numberTriangC = IN[3]
mintr = IN[4]
maxtr = IN[5]


myRandom = System.Random()
out = []
# define a default list as process
lstOperation = ['Operation1', 'Operation2', 'Operation3']
with moduleBarUtils.MyProgressBroadcaster(lstOperation, "Test IronPython2") as broadcaster:
	# set new value progress Bar for Operation1
	broadcaster.SetProgressAtIndex(0, numberTriangA)
	tringleGenerator(numberTriangA)

	# set new value progress Bar for Operation2
	broadcaster.SetProgressAtIndex(1, numberTriangB)
	tringleGenerator(numberTriangB)

	# set new value progress Bar for Operation3
	broadcaster.SetProgressAtIndex(2, numberTriangC)
	tringleGenerator(numberTriangC)

OUT = out
# ----------------------------------------
